# Grasshopper definition from_building_footprints.gh (Grasshopper 1.0.7)

# ----
# Full Bldg Small Office ProgramType
panel = Panel("""pre_1980::SmallOffice::ClosedOffice
pre_1980::SmallOffice::Conference
pre_1980::SmallOffice::Corridor
pre_1980::SmallOffice::OpenOffice
pre_1980::SmallOffice::Restroom
pre_1980::SmallOffice::Storage""")
panel_2 = Panel("""0.15
0.15
0.2
0.4
0.05
0.05""")
blendprograms = HBBlendProgramTypes(name="SmallOfficeBuilding", programs=panel, ratios=panel_2)  # -> program; plug-in component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

# ----
# Construction Set
bldg_vintage = Dragonfly_BldgAge({"ASHRAE 90.1 2013  |  IECC 2015": "2013", "ASHRAE 90.1 2010  |  IECC 2012": "2010", "ASHRAE 90.1 2007  |  IECC 2009": "2007", "ASHRAE 90.1 2004  |  IECC 2006": "2004", "1980-2004 (CBECS)": "1980_2004", "Pre-1980 (CBECS)": "pre_1980"}, selected="Pre-1980 (CBECS)")
constr_type = Dragonfly_BldgAge({"SteelFramed", "WoodFramed", "Mass", "Metal Building"}, selected="WoodFramed")
climate_zone = Dragonfly_BldgAge({"1 - Very Hot": "1", "2 - Hot": "2", "3 - Warm": "3", "4 - Mixed": "4", "5 - Cool": "5", "6 - Cold": "6", "7 - Very Cold": "7", "8 - Subarctic": "8"}, selected="5 - Cool")
searchconstrset = HBSearchConstructionSets(climate_zone=climate_zone, vintage=bldg_vintage, constr_type=constr_type)  # -> constr_set; plug-in component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

commercialfootprints = Geometry([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])
panel_3 = Panel("""4
3
3
3""")
buildingfootprint = DFBuildingFromFootprint(
    footprint_geo=flatten(commercialfootprints),
    floor_to_floor=flatten(panel_3),
    name="CommercialBldg",
    program=blendprograms,
    constr_set=searchconstrset,
    run=Toggle(True))  # -> report, buildings; plug-in component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

residentialfootprints = Geometry([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])
panel_4 = Panel("""3
3
3""")
buildingfootprint_2 = DFBuildingFromFootprint(
    footprint_geo=flatten(residentialfootprints),
    floor_to_floor=flatten(panel_4),
    name="ResidentialBldg",
    program="pre_1980::MidriseApartment::Apartment",
    constr_set=searchconstrset,
    run=Toggle(True))  # -> report, buildings; plug-in component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
simpleratio = DFSimpleGlazingRatio(ratio="0.25")  # -> glz_par; plug-in component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
applyfacadepar = DFApplyFacadeParameters(df_obj=flatten(buildingfootprint_2.buildings), glz_par=simpleratio)  # -> report, df_obj; plug-in component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

decnstrdf = DFDeconstructObject(df_obj=buildingfootprint.buildings)  # -> stories, room2ds; plug-in component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
decnstrdfall = DFDeconstructAllObject()  # -> all_stories, all_room2ds; plug-in component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
repeatingratio = DFRepeatingGlazingRatio()  # -> glz_par; plug-in component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

# ---- group: properties for ground floor retail
item = ListItem(List=decnstrdf.stories, Index="0", Wrap=True)
reassignprop = DFReassignProperties(df_obj=item, program="pre_1980::StripMall::Type 1")  # -> df_obj; plug-in component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
simpleratio_2 = DFSimpleGlazingRatio(ratio="0.4")  # -> glz_par; plug-in component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
applyfacadepar_2 = DFApplyFacadeParameters(df_obj=reassignprop, glz_par=simpleratio_2)  # -> report, df_obj; plug-in component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

# ---- group: properties for above-ground office
item_2 = ListItem(List=decnstrdf.stories, Index="1", Wrap=True)
simpleratio_3 = DFSimpleGlazingRatio(ratio="0.25")  # -> glz_par; plug-in component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
applyfacadepar_3 = DFApplyFacadeParameters(df_obj=item_2, glz_par=simpleratio_3)  # -> report, df_obj; plug-in component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

# ----
txt = Text(buildingfootprint.buildings)
split = TextSplit(Text=txt, Separators=":")
item_3 = ListItem(List=split, Index="-1", Wrap=True)  # -> simplify(Item)

all_commercial_stories = Data(simplify([applyfacadepar_2.df_obj, applyfacadepar_3.df_obj]))
buildingstories = DFBuildingFromStories(stories=all_commercial_stories, name=item_3, constr_set=searchconstrset)  # -> report, building; plug-in component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
all_buildings = Data(flatten([buildingstories.building, applyfacadepar.df_obj]))
buildingtohoneybee = DFBuildingToHoneybee(buildings=flatten(all_buildings), use_multiplier=Toggle(False), shade_dist="50", run=Toggle(False))  # -> report, models; plug-in component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
item_4 = ListItem(List=buildingtohoneybee.models, Index=Slider(6, range=0..10), Wrap=True)

# ----
# Simulation Parameters
toggle = BooleanToggle(True)
simoutput = HBSimulationOutput(zone_energy_use=toggle, summary_reports="AllSummary")  # -> report, sim_output; plug-in component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
shadowcalc = HBShadowCalculation(solar_dist="FullExteriorWithReflections")  # -> shadow_calc; plug-in component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
simpar = HBSimulationParameter(output=simoutput.sim_output, timestep=6, shadow_calc=shadowcalc)  # -> sim_par; plug-in component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

separatemodel = HBSeparateModel()  # -> rooms, faces, apertures, doors, shades; plug-in component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
vizall = HBVizualizeAll(hb_obj=flatten(item_4))  # -> geo; plug-in component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

# ----
# Download EPW File
panel_5 = Panel("https://www.energyplus.net/weather-download/north_and_central_america_wmo_region_4/USA/MA/USA_MA_Boston-Logan.Intl.AP.725090_TMY3/all")
downloadweather = LadybugPlus_DownloadWeather(weather_URL=panel_5)  # -> epw_file, stat_file, ddy_file; plug-in component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

panel_6 = Panel("C:\Users\chris\Documents\GitHub\dragonfly-grasshopper\dragonfly_grasshopper")
createuo = LBCreateUserObject(folder=panel_6, change_type="ignore", export=Toggle(False))  # -> read_me; plug-in component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

modeltoidf = HBModelToIDF(
    model=buildingtohoneybee.models,
    epw_file=downloadweather.epw_file,
    sim_par=simpar,
    folder="C:\Users\chris\honeybee\district_model",
    write=Toggle(False))  # -> report, idf, sql, eio, rdd, html; plug-in component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
