# Grasshopper definition open_dss_example.gh (Grasshopper 1.0.7)

# ----
# Create Blended Building Programs
panel = Panel("""2013::Hospital::Corridor
2013::Hospital::Dining
2013::Hospital::Lobby
2013::Hospital::NurseStn
2013::Hospital::Office
2013::Hospital::PatRoom""")
panel_2 = Panel("""2013::FullServiceRestaurant::Dining
2013::FullServiceRestaurant::Kitchen""")
panel_3 = Panel("""2013::StripMall::Type 2
2013::FullServiceRestaurant::Dining
2013::FullServiceRestaurant::Kitchen
2013::SmallHotel::Corridor
2013::SmallHotel::GuestLounge
2013::SmallHotel::GuestRoom
2013::SmallHotel::Office""")
panel_4 = Panel("""2013::SmallOffice::ClosedOffice
2013::SmallOffice::Conference
2013::SmallOffice::Corridor
2013::SmallOffice::OpenOffice
2013::SmallOffice::Restroom
2013::SmallOffice::Storage""")
panel_5 = Panel("""2013::MidriseApartment::Apartment
2013::MidriseApartment::Corridor
2013::MidriseApartment::Office""")
panel_6 = Panel("""0.15
0.15
0.2
0.4
0.05
0.05""")
panel_7 = Panel("""0.6
0.35
0.05""")
panel_8 = Panel("""0.3
0.1
0.1
0.05
0.05
0.4""")
panel_9 = Panel("""0.8
0.2""")
panel_10 = Panel("""0.3
0.25
0.05
0.1
0.05
0.2
0.05""")
blendprograms = HBBlendProgramTypes(name="Residential Building", programs=panel_5, ratios=panel_7)  # -> program; plug-in component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
blendprograms_2 = HBBlendProgramTypes(name="Office Building", programs=panel_4, ratios=panel_6)  # -> program; plug-in component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
blendprograms_3 = HBBlendProgramTypes(name="Mixed Use Building", programs=panel_3, ratios=panel_10)  # -> program; plug-in component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
blendprograms_4 = HBBlendProgramTypes(name="Restaurant Building", programs=panel_2, ratios=panel_9)  # -> program; plug-in component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
blendprograms_5 = HBBlendProgramTypes(name="Hospital Building", programs=panel, ratios=panel_8)  # -> program; plug-in component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

# ----
# Basic Building Properties
building_names = Panel("""Mixed_use 1
Restaurant 1
Residential 1
Residential 2
Residential 4
Residential 5
Office 1
Hospital 1
Hospital 2
Mixed use 2
Residential 3
Mall 1
Residential 6""")
floor_to_floor_m = Panel("3.5")
number_of_stories = Panel("""4
1
3
3
1
1
6
10
3
8
3
3
10""")
footprints = Geometry(simplify(graft([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])))
perimeter_depth_m = Panel("10")
dup = DuplicateData(Data=floor_to_floor_m, Number=number_of_stories, Order=True)  # -> simplify(Data)
data = Data(simplify(graft(building_names)))

# ----
# Construction Set
bldg_vintage = Dragonfly_BldgAge({"ASHRAE 90.1 2013  |  IECC 2015": "2013", "ASHRAE 90.1 2010  |  IECC 2012": "2010", "ASHRAE 90.1 2007  |  IECC 2009": "2007", "ASHRAE 90.1 2004  |  IECC 2006": "2004", "1980-2004 (CBECS)": "1980_2004", "Pre-1980 (CBECS)": "pre_1980"}, selected="ASHRAE 90.1 2013  |  IECC 2015")
constr_type = Dragonfly_BldgAge({"SteelFramed", "WoodFramed", "Mass", "Metal Building"}, selected="SteelFramed")
climate_zone = Dragonfly_BldgAge({"1 - Very Hot": "1", "2 - Hot": "2", "3 - Warm": "3", "4 - Mixed": "4", "5 - Cool": "5", "6 - Cold": "6", "7 - Very Cold": "7", "8 - Subarctic": "8"}, selected="5 - Cool")
constrsetclimate = HBConstructionSetByClimate(climate_zone=climate_zone, vintage=bldg_vintage, constr_type=constr_type)  # -> constr_set; plug-in component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
data_2 = Data(constrsetclimate)

# ----
# Order Programs
# to Match Footprints
merge = Merge(
    Data1=blendprograms_3,
    Data2=blendprograms_4,
    Data3=blendprograms,
    Data4=blendprograms,
    Data5=blendprograms,
    Data6=blendprograms,
    Data7=blendprograms_2,
    Data8=blendprograms_5,
    Data9=blendprograms_5,
    Data10=blendprograms_3,
    Data11=blendprograms,
    Data12="2013::StripMall::Type 2",
    Data13=blendprograms)  # -> simplify(graft(Result))

# ----
# Create Buildings
buildingfootprint = DFBuildingFromFootprint(
    footprint_geo=footprints,
    floor_to_floor=dup,
    perim_offset=perimeter_depth_m,
    name=data,
    program=merge,
    constr_set=data_2,
    run=Toggle(True))  # -> report, buildings; plug-in component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
topbottom = DFSeparateTopBottom(buildings=buildingfootprint.buildings)  # -> simplify(buildings); plug-in component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

# ----
# Assign Windows
window_ratios_per_building = Panel("""0.2
0.35
0.3
0.3
0.3
0.3
0.7
0.6
0.6
0.35
0.3
0.25
0.4""")
simpleratiopar = DFSimpleWindowRatioParameters(ratio=window_ratios_per_building)  # -> simplify(graft(win_par)); plug-in component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
applyfacadepar = DFApplyFacadeParameters(df_obj=topbottom, win_par=simpleratiopar)  # -> report, df_obj; plug-in component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

# ----
# Search Transformers + Wires
searchopendss = DFSearchOpenDSS()  # -> transformers, wires; plug-in component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
panel_11 = Panel(searchopendss.wires)
panel_12 = Panel(searchopendss.transformers)

# ----
# Assign HVAC
hvac_templates = Panel("""VAV_Chiller_Boiler
VAV_Chiller_Boiler
PTAC_BoilerBaseboard
PTAC_BoilerBaseboard
PTAC_BoilerBaseboard
PTAC_BoilerBaseboard
VAV_Chiller_Boiler
VAV_Chiller_Boiler
VAV_Chiller_Boiler
VAV_Chiller_Boiler
PTAC_BoilerBaseboard
VAV_Chiller_Boiler
PTAC_BoilerBaseboard""")
data_3 = Data(simplify(graft(hvac_templates)))
dfallairhvac = DFAllAirHVAC(df_objs=applyfacadepar.df_obj, system_type=data_3, name=data_3)  # -> report, df_objs; plug-in component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

# ----
# Transformers + Substation
transformer_properties = Panel("""Transformer--100KVA PM
Transformer--50KVA PM
Transformer--50KVA CT
Transformer--75KVA CT
Transformer--75KVA PM""")
transformers = Geometry([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])
substation = Geometry(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)
transformer = DFTransformer(geo=transformers, properties=transformer_properties)  # -> transformer; plug-in component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
substation_2 = DFSubstation(geo=substation)  # -> substation; plug-in component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

# ----
# Electric Connectors
wires_type_6 = Panel("""UG TPLX 2/0 C
UG TPLX 2/0 B
UG TPLX 2/0 A""")
wires_type_2 = Panel("""OH AL 1/0 A
OH AL 1/0 B
OH AL 1/0 C
OH AL 1/0 N""")
wires_type_3 = Panel("""UG TPLX 1/0 A
UG TPLX 1/0 B
UG TPLX 1/0 C""")
wires_type_4 = Panel("""OH TPLX 2/0 S2
OH TPLX 2/0 N
OH TPLX 2/0 S1""")
wires_type_5 = Panel("""OH TPLX 2/0 S1
OH TPLX 2/0 S2
OH TPLX 2/0 N""")
wires_type_1 = Panel("""OH AL 2/0 A
OH AL 2/0 B
OH AL 2/0 C
OH AL 2/0 N""")
wires_type_2_2 = Geometry([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])
wires_type_3_2 = Geometry([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])
wires_type_4_2 = Geometry([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])
wires_type_5_2 = Geometry([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])
wires_type_1_2 = Geometry([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])
wires_type_6_2 = Geometry(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)
connector = DFElectricalConnector(geo=wires_type_1_2, wires=wires_type_1)  # -> connector; plug-in component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
connector_2 = DFElectricalConnector(geo=wires_type_2_2, wires=wires_type_2)  # -> connector; plug-in component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
connector_3 = DFElectricalConnector(geo=wires_type_3_2, wires=wires_type_3)  # -> connector; plug-in component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
connector_4 = DFElectricalConnector(geo=wires_type_4_2, wires=wires_type_4)  # -> connector; plug-in component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
connector_5 = DFElectricalConnector(geo=wires_type_5_2, wires=wires_type_5)  # -> connector; plug-in component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
connector_6 = DFElectricalConnector(geo=wires_type_6_2, wires=wires_type_6)  # -> connector; plug-in component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

# ----
# Create Model
panel_13 = Panel("Buffalo New Development")
model = DFModel(buildings=flatten(dfallairhvac.df_objs), name=panel_13)  # -> report, model; plug-in component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

# ----
# Create Electric
# Infrastructure
network = DFElectricalNetwork(
    substation=substation_2,
    transformers=flatten(transformer),
    connectors=flatten([connector, connector_2, connector_3, connector_4, connector_5, connector_6]))  # -> report, network; plug-in component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

# ----
# Visualize Model Properties
room2dattr = DFRoom2DAttributes({"Display Name": "display_name", "Simulation Name (Identifier)": "identifier", "Floor-To-Ceiling Height": "floor_to_ceiling_height", "Floor Elevation": "floor_height", "Ceiling Elevation": "ceiling_height", "Is Ground Contact": "is_ground_contact"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}, selected="Program": "properties.energy.program_type.display_name")
data_4 = Data(flatten(model.model))
colorroom2dattr = DFColorRoom2DAttributes(df_obj=flatten(data_4), attribute=room2dattr)  # -> mesh, legend, wire_frame, values, colors; plug-in component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

# ----
# Download EPW File
panel_14 = Panel("https://www.energyplus.net/weather-download/north_and_central_america_wmo_region_4/USA/NY/USA_NY_Buffalo-Greater.Buffalo.Intl.AP.725280_TMY/all")
analysisperiod = LBAnalysisPeriod(start_month="8", start_day=1, start_hour=0, end_month="8")  # -> period, hoys, dates; plug-in component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
downloadepw = LBDownloadWeather(weather_URL=panel_14)  # -> epw_file, stat_file, ddy_file; plug-in component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
simpar = HBSimulationParameter(run_period=analysisperiod.period, timestep="1")  # -> sim_par; plug-in component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

# ----
# Write geoJSON
directory_into_which_files_will_be_writt = Panel("C:\ladybug\buffalo_district")  # "Directory into which files will be written"
constrloc = LBConstructLocation(name="Buffalo, NY", latitude="42.813153", longitude="-78.852466", time_zone="-5", elevation="200")  # -> location; plug-in component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
pt = Point(Point(0, 0, 0))
togeojson = DFModelToGeoJSON(
    model=model.model,
    location=constrloc,
    point=pt,
    use_multiplier=Toggle(False),
    shade_dist="50",
    elec_network=network.network,
    folder=directory_into_which_files_will_be_writt,
    write=Toggle(False))  # -> report, geojson, hb_jsons, hb_models; plug-in component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

# ----
# Run Simulation
panel_15 = Panel("14")
runurbanopt = DFRunURBANopt(geojson=togeojson.geojson, epw_file=downloadepw.epw_file, sim_par=simpar, cpus=panel_15, run=Toggle(False))  # -> report, scenario, osm, idf, sql, zsz, rdd, html; plug-in component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

# ----
# Compute EUI
# (just over run period)
toggle = BooleanToggle(True)
eui = HBEndUseIntensity(sql=runurbanopt.sql, ip=toggle)  # -> eui, eui_end_use, end_uses, gross_floor; plug-in component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
eui_kbtu_ft2 = Panel(eui.eui)
panel_16 = Panel(eui.eui_end_use)
panel_17 = Panel(eui.end_uses)

# ----
# Run OpenDSS
runopendss = DFRunOpenDSS(geojson=togeojson.geojson, scenario=runurbanopt.scenario, run=Toggle(False))  # -> report, buildings, connectors, transformers; plug-in component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

# ----
# Visualize Results
opendssresult = DFReadOpenDSSResult(dss_csv=runopendss.transformers)  # -> factors, condition; plug-in component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
hourlyplot = LBHourlyPlot(data=opendssresult.factors, base_pt="0,-150,0", x_dim="4")  # -> report, mesh, legend, borders, labels, title; plug-in component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
