# Grasshopper definition peak_load_example.gh (Grasshopper 1.0.7)

# ----
# Full Bldg Small Office ProgramType
panel = Panel("""2013::LargeOffice::ClosedOffice
2013::LargeOffice::Conference
2013::LargeOffice::Corridor
2013::LargeOffice::OpenOffice
2013::LargeOffice::Restroom
2013::LargeOffice::Storage""")
panel_2 = Panel("""0.15
0.15
0.2
0.4
0.05
0.05""")
blendprograms = HBBlendProgramTypes(name="LargeOfficeBuilding", programs=panel, ratios=panel_2)  # -> program; plug-in component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

# ----
# Construction Set
bldg_vintage = Dragonfly_BldgAge({"ASHRAE 90.1 2013  |  IECC 2015": "2013", "ASHRAE 90.1 2010  |  IECC 2012": "2010", "ASHRAE 90.1 2007  |  IECC 2009": "2007", "ASHRAE 90.1 2004  |  IECC 2006": "2004", "1980-2004 (CBECS)": "1980_2004", "Pre-1980 (CBECS)": "pre_1980"}, selected="ASHRAE 90.1 2013  |  IECC 2015")
constr_type = Dragonfly_BldgAge({"SteelFramed", "WoodFramed", "Mass", "Metal Building"}, selected="SteelFramed")
climate_zone = Dragonfly_BldgAge({"1 - Very Hot": "1", "2 - Hot": "2", "3 - Warm": "3", "4 - Mixed": "4", "5 - Cool": "5", "6 - Cold": "6", "7 - Very Cold": "7", "8 - Subarctic": "8"}, selected="5 - Cool")
searchconstrset = HBSearchConstructionSets(climate_zone=climate_zone, vintage=bldg_vintage, constr_type=constr_type)  # -> constr_set; plug-in component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

# ----
# Create Office Buildings
panel_3 = Panel("OfficeBldg")
officesolids = Geometry([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])
panel_4 = Panel("""1@5
2@4
@3""")
buildingsolid = DFBuildingFromSolid(
    bldg_geo=flatten(officesolids),
    floor_to_floor=panel_4,
    name=panel_3,
    program=blendprograms,
    constr_set=searchconstrset,
    run=Toggle(True))  # -> report, buildings; plug-in component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
decnstrdf = DFDeconstructObject(df_obj=buildingsolid.buildings)  # -> stories, room2ds; plug-in component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

wires = BrepWireframe(Brep=officesolids, Density=-1)
panel_5 = Panel("""@4
@3""")

# ----
# Create Residential Buildings
panel_6 = Panel("2013::MidriseApartment::Apartment")
residentialsolids = Geometry([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])
buildingsolid_2 = DFBuildingFromSolid(
    bldg_geo=flatten(residentialsolids),
    floor_to_floor=panel_5,
    name="ResidentialBldg",
    program=panel_6,
    constr_set=searchconstrset,
    run=Toggle(True))  # -> report, buildings; plug-in component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
simpleratiopar = DFSimpleWindowRatioParameters(ratio="0.25")  # -> win_par; plug-in component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
applyfacadepar = DFApplyFacadeParameters(df_obj=flatten(buildingsolid_2.buildings), win_par=simpleratiopar)  # -> report, df_obj; plug-in component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

wires_2 = BrepWireframe(Brep=residentialsolids, Density=-1)

# ---- group: properties for ground floor retail
item = ListItem(List=decnstrdf.stories, Index="0", Wrap=True)
reassignprop = DFReassignEnergyProperties(df_obj=item, program="2013::Retail::Retail")  # -> df_obj; plug-in component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
overhangpar = DFOverhangParameters(depth="4", angle="10")  # -> shd_par; plug-in component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
simpleratiopar_2 = DFSimpleWindowRatioParameters(ratio="0.65")  # -> win_par; plug-in component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
applyfacadepar_2 = DFApplyFacadeParameters(df_obj=reassignprop, win_par=simpleratiopar_2, shd_par=overhangpar)  # -> report, df_obj; plug-in component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

# ---- group: properties for above-ground office
cull_i = CullIndex(List=decnstrdf.stories, Indices="0", Wrap=True)
simpleratiopar_3 = DFSimpleWindowRatioParameters(ratio="0.4")  # -> win_par; plug-in component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
applyfacadepar_3 = DFApplyFacadeParameters(df_obj=cull_i, win_par=simpleratiopar_3)  # -> report, df_obj; plug-in component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

# ----
txt = Text(buildingsolid.buildings)
split = TextSplit(Text=txt, Separators=":")
item_2 = ListItem(List=split, Index="-1", Wrap=True)  # -> simplify(Item)

stories = Data(simplify(applyfacadepar_3.df_obj))
stories_2 = Data(simplify(applyfacadepar_2.df_obj))
stories_3 = Data(simplify([stories, stories_2]))
buildingstories = DFBuildingFromStories(stories=stories_3, name=item_2, constr_set=searchconstrset)  # -> report, building; plug-in component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
commercialbldgs = Data(flatten(buildingstories.building))
all_buildings = Data(flatten([commercialbldgs, applyfacadepar.df_obj]))

# ----
# Create Dragonfly and
# Honeybee Models
panel_7 = Panel("ParkingStructure")
contextshade = Geometry([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])
context = DFContextShade(geo=contextshade, name=panel_7)  # -> report, context; plug-in component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
model = DFModel(buildings=flatten(all_buildings), context=flatten(context.context), name="Mass Pike District")  # -> report, model; plug-in component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
# 1
# Translate Models
# to Honeybee
toggle = BooleanToggle(False)
tohoneybee = DFModelToHoneybee(model=model.model, use_multiplier=Toggle(False), shade_dist="50", run=toggle)  # -> report, hb_models; plug-in component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

# ----
# Simulation Parameters
toggle_2 = BooleanToggle(True)
simcontrol = HBSimulationControl(for_sizing_period=toggle_2, for_run_period=Toggle(False))  # -> sim_control; plug-in component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
shadowcalc = HBShadowCalculation(solar_dist="FullExteriorWithReflections")  # -> shadow_calc; plug-in component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
simpar = HBSimulationParameter(timestep=6, sim_control=simcontrol, shadow_calc=shadowcalc)  # -> sim_par; plug-in component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

# ----
# Download EPW File
panel_8 = Panel("https://www.energyplus.net/weather-download/north_and_central_america_wmo_region_4/USA/MA/USA_MA_Boston-Logan.Intl.AP.725090_TMY3/all")
downloadepw = LBDownloadWeather(weather_URL=panel_8)  # -> epw_file, stat_file, ddy_file; plug-in component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

directory_into_which_files_will_be_writt = Panel("C:\district_model_sizing")  # "Directory into which files will be written"

# ----
# Export to OpenStudio
# 2
# Export
# OSW Files
toggle_3 = BooleanToggle(False)
modeltoosm = HBModelToOSM(
    model=tohoneybee.hb_models,
    epw_file=downloadepw.epw_file,
    sim_par=simpar,
    folder=directory_into_which_files_will_be_writt,
    write=toggle_3)  # -> report, jsons, osw, osm, idf, sql, zsz, rdd, html; plug-in component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

# ----
# Run Simulations
# 3
# Translate
# OSW to OSM
toggle_4 = BooleanToggle(False)
runosw = HBRunOSW(osw=modeltoosm.osw, epw_file=downloadepw.epw_file, parallel=Toggle(True), translate=toggle_4, run=toggle_4)  # -> report, osm, idf, sql, zsz, rdd, html; plug-in component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

readhvac = HBReadHVACSizing(sql=runosw.sql)  # -> zone_names, zone_peak_cool, zone_peak_heat, comp_types, comp_properties, comp_values; plug-in component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
ma = MassAddition(Input=flatten(readhvac.zone_peak_cool))  # -> Result, PartialResults
ma_2 = MassAddition(Input=flatten(readhvac.zone_peak_heat))  # -> Result, PartialResults
division = Division(A=ma.Result, B="1000")
division_2 = Division(A=ma_2.Result, B="1000")
total_zone_level_cooling_capacity_kw = Panel(division)
total_zone_level_heating_capacity_kw = Panel(division_2)

readzsz = HBReadZoneSizing(zsz=runosw.zsz)  # -> cooling_load, heating_load; plug-in component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

massarithop = LBMassArithmeticOperation(data=readzsz.heating_load, type="District Design Day Heating Demand")  # -> data; plug-in component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
tounit = LBToUnit(data=flatten(massarithop), to_unit="kW")  # -> all_unit, data; plug-in component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

massarithop_2 = LBMassArithmeticOperation(data=readzsz.cooling_load, type="District Design Day Cooling Demand")  # -> data; plug-in component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
tounit_2 = LBToUnit(data=flatten(massarithop_2), to_unit="kW")  # -> all_unit, data; plug-in component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

colrange = LBColorRange(index="16")  # -> colors; plug-in component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
colrange_2 = LBColorRange(index="17")  # -> colors; plug-in component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
legendpar = Ladybug_LegendParameters(lowBound="0", highBound="20000", customColors=flatten(colrange))  # -> legendPar; plug-in component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
legendpar_2 = Ladybug_LegendParameters(lowBound="0", highBound="20000", customColors=flatten(colrange_2))  # -> legendPar; plug-in component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
ladybug = Ladybug_Ladybug()  # -> Vviiiiiiiiiizzz; plug-in component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
tolegacy = LBDataToLegacy(data=tounit.data)  # -> data; plug-in component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
tolegacy_2 = LBDataToLegacy(data=tounit_2.data)  # -> data; plug-in component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
linechart = Ladybug_LineChart(
    inputData=flatten(tolegacy),
    chartType="2",
    altTitle="District Design Day Heating Demand",
    altYAxisTitle="Heating Demand (kW)",
    basePoint="580,0,0",
    xScale="4",
    legendPar=legendpar)  # -> readMe, dataMesh, dataCurves, dataCrvColors, graphAxes, graphLabels, title, titleBasePt, legend, legendBasePt; plug-in component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
linechart_2 = Ladybug_LineChart(
    inputData=flatten(tolegacy_2),
    chartType="2",
    altTitle="District Design Day Cooling Demand",
    altYAxisTitle="Cooling Demand (kW)",
    basePoint="500,0,0",
    xScale="4",
    legendPar=legendpar_2)  # -> readMe, dataMesh, dataCurves, dataCrvColors, graphAxes, graphLabels, title, titleBasePt, legend, legendBasePt; plug-in component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
geo = Geometry([linechart.dataMesh, linechart.dataCurves, linechart.dataCrvColors, linechart.graphAxes, linechart.graphLabels, linechart.title])
geo_2 = Geometry([linechart_2.dataMesh, linechart_2.dataCurves, linechart_2.dataCrvColors, linechart_2.graphAxes, linechart_2.graphLabels, linechart_2.title])
