# Grasshopper definition sloped_roof_residential.gh (Grasshopper 1.0.7)

building_massing_geometries = Geometry([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])

# ----
# Create the Bsse Building
toggle = BooleanToggle(True)
buildingsolid = DFBuildingFromSolid(bldg_geo=flatten(building_massing_geometries), floor_to_floor="3", run=toggle)  # -> report, buildings; plug-in component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
repeatingwhpar = DFRepeatingWindowWidthHeightParameters(win_height="1.8", win_width="1")  # -> win_par; plug-in component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
applyfacadepar = DFApplyFacadeParameters(df_obj=buildingsolid.buildings, win_par=repeatingwhpar)  # -> report, df_obj; plug-in component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
topbottom = DFSeparateTopBottom(buildings=flatten(applyfacadepar.df_obj))  # -> buildings; plug-in component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

# ----
# Extract Upward-Facing Geometries
debrep = DeconstructBrep(Brep=building_massing_geometries)  # -> Faces, Edges, Vertices
evalsrf = EvaluateSurface(Surface=debrep.Faces, Point="0,0")  # -> Point, Normal, UDirection, VDirection, Frame
Z = UnitZ(Factor=1)
angle = Angle(VectorA=Z, VectorB=evalsrf.Normal)  # -> Angle, Reflex
rad = Radians(Degrees="89")
smaller = SmallerThan(FirstNumber=angle.Angle, SecondNumber=rad)  # -> SmallerThan, OrEqualTo
dispatch = Dispatch(List=debrep.Faces, DispatchPattern=smaller.SmallerThan)  # -> ListA, ListB

# ----
# Apply Sloped Roofs
buildings = Data(simplify(graft(topbottom)))
roof_geo = Geometry(simplify(dispatch.ListA))
applyroof = DFApplyRoof(df_obj=buildings, roof_geo=roof_geo)  # -> df_obj; plug-in component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

model = DFModel(buildings=flatten(applyroof))  # -> report, model; plug-in component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

# ----
# Visualize Model in 3D
toggle_2 = BooleanToggle(True)
tohoneybee = DFModelToHoneybee(model=model.model, obj_per_model="District", run=toggle_2)  # -> report, hb_models; plug-in component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
vizbytype = HBVisualizeByType(hb_objs=tohoneybee.hb_models)  # -> walls, interior_walls, roofs, ceilings, exterior_floors, interior_floors, air_walls, apertures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; plug-in component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
